# Grasshopper definition ARCH509_RoboticBrickAssembly_KR6Workcell_Base.gh (Grasshopper 1.0.7)

# ----
# Unload Modules
init_button = Button()
python = GhPythonScript(init=init_button)  # -> out
# ---------- python: Python ----------
__author__ = "aaadel"
__version__ = "2020.09.28"

import sys

# The following function is inserted here from compas (see: https://compas.dev/)
def unload_modules(top_level_module_name):
    """Unloads all modules named starting with the specified string.

    This function eases the development workflow when editing a library that is
    used from Rhino/Grasshopper.

    Parameters
    ----------
    top_level_module_name : :obj:`str`
        Name of the top-level module to unload.

    Returns
    -------
    list
        List of unloaded module names.
    """
    modules = filter(lambda m: m.startswith(
        top_level_module_name), sys.modules)

    for module in modules:
        sys.modules.pop(module)

        return modules

print(unload_modules('robotic_brick_assembly'))
# ---------- end python ----------

# ---- group: Maximum Rotation
degrees = Slider(0, range=0..90)

# ----
# Inputs
attractorpt = Point(Point(0.2322775801, 0.748601421, 0.0593690657))
wallbrep = Brep(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)

# ----
# Required plugins:
# COMPAS
# COMPAS FAB
# Automatic Path Loading
panel = Panel("main.py")
path = GhPythonScript(f=panel)  # -> p
# ---------- path: Python ----------
__author__ = "aaadel"
__version__ = "2020.09.28"

from os import path
import robotic_brick_assembly

p = path.join(path.dirname(robotic_brick_assembly.__file__), f)
# ---------- end path ----------
file = ReadFile(F=path, PerLineParse=False)  # -> C
#   port F: Uri of file to read
# ---------- file: VB line parser ----------
    action = GH_LineParserAction.Include
    Return line

    'Parse the line and return some data that represents the line.
    'If the line cannot be parsed, you can return Nothing and
    'assign a different action.
    'The default implementation is to just return the line itself.
    'If you return types that implement IGH_Goo, this component
    'will work substantially faster.
# ---------- end file ----------

# ----
# Brick Wall Generation
python_2 = GhPythonScript(Code=file, Init=init_button, Wall_brep=wallbrep, Attractor_point=attractorpt, Max_rotation=degrees)  # -> Out, BrickWall_01, Bricks, Bricks_breps

# ----
# ARCH 509 Robotic Fabrication W23
# University of Michigan, Taubman College of Architecture and Urban Planning
# Prof. Arash Adel | aaadel@umich.edu
# 
# Maintained by Daniel Ruan | deltar@umich.edu
panel_2 = Panel(python_2.Out)

lng = ListLength(List=python_2.Bricks_breps)
panel_3 = Panel(lng)
panel_4 = Panel("number of bricks")
number_slider = Slider(0, range=0..145)
item = ListItem(List=python_2.Bricks, Index=number_slider, Wrap=True)

# ---- group: Display Selected Brick
item_2 = ListItem(List=python_2.Bricks_breps, Index=number_slider, Wrap=True)
material = CreateMaterial(Diffuse=RGB(255, 0, 255), Specular=RGB(255, 255, 255), Emission=RGB(0, 0, 0), Transparency=0, Shine=0)
preview = CustomPreview(Geometry=item_2, Material=material)

# ---- group: Display Brick Wall on the Assembly Platform
material_2 = CreateMaterial(Diffuse=RGB(200, 255, 255), Specular=RGB(255, 255, 255), Emission=RGB(0, 0, 0), Transparency=0.95, Shine=0)
preview_2 = CustomPreview(Geometry=python_2.Bricks_breps, Material=material_2)

# ---- group: Brick loading position
brep = Brep(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)

# ----
# Match the two lists (Pickup Bricks and the Wall Bricks)
multiplication_factor = Slider(0, range=0..30)
bricks_per_chunk = Panel("5")
repeat = RepeatData(Data=brep, Length=bricks_per_chunk)
python_3 = GhPythonScript(wall_bricks=python_2.Bricks, jig_bricks_brep=repeat, mult_factor=multiplication_factor)  # -> out, bricks_chunk, wall_bricks_chunk, jig_bricks_chunk; inputs wall_bricks: list, jig_bricks_brep: list of Brep, mult_factor: Int32
# ---------- python_3: Python ----------
__author__ = "aaadel"
__version__ = "2019.10.13"

#print bricks_brep

#Number of bricks in the jig
jig_num_bricks = len(jig_bricks_brep)

# Number of bricks in the wall
wall_num_bricks = len(wall_bricks)
#print wall_num_bricks

# Multiplication (lower_bound index of the chunk list
wall_lower_bound = mult_factor * jig_num_bricks

# Remaining bricks
remaining_bricks = wall_num_bricks - wall_lower_bound

# Minimum of remaining_bricks and jig_num_bricks
min_val = min(remaining_bricks, jig_num_bricks)
print wall_lower_bound
print remaining_bricks
print min_val
# Finding the upper bound index of the chunk list
wall_upper_bound = wall_lower_bound + min_val
# Wall Bricks Chunk list (chunk of bricks)
wall_bricks_chunk = wall_bricks[wall_lower_bound: wall_upper_bound]
bricks_chunk = [brick.shape for brick in wall_bricks_chunk]

# Jig Bricks Chunk list
jig_lower_bound = 0
jig_upper_bound = min_val
jig_bricks_chunk = jig_bricks_brep[jig_lower_bound: jig_upper_bound]
print jig_bricks_chunk
# ---------- end python_3 ----------

# ----
# PICK UP SEQUENCE LOGIC
# PLACEMENT  SEQUENCE LOGIC
z_retract_m = Panel("0.01")
python_4 = GhPythonScript(pickup_bricks=python_3.jig_bricks_chunk, z_retract=z_retract_m)  # -> out, pickup_frames, offset_pickup_frames; inputs pickup_bricks: list of Brep
# ---------- python_4: Python ----------
__author__ = "aaadel"
__version__ = "2020.10.05"


import Rhino.Geometry as rg
pickup_frames = []
offset_pickup_frames = []
#print(pickup_bricks[1])
for pickup_brick in pickup_bricks:
    pckup_bks_centroid = rg.AreaMassProperties.Compute(pickup_brick).Centroid
    pickup_frame = rg.Plane(pckup_bks_centroid,-rg.Vector3d.XAxis,-rg.Vector3d.YAxis)
    pickup_frames.append(pickup_frame)
    offset_pickup_frame = rg.Plane(pickup_frame)
    rg.Plane.Translate(offset_pickup_frame,rg.Vector3d.ZAxis*z_retract)
    offset_pickup_frames.append(offset_pickup_frame)
# ---------- end python_4 ----------

python_5 = GhPythonScript(bricks=python_3.wall_bricks_chunk, z_retract=z_retract_m)  # -> out, placement_frames, offset_placement_frames; inputs bricks: list
# ---------- python_5: Python ----------
__author__ = "aaadel"
__version__ = "2020.10.05"


import Rhino.Geometry as rg

leadin_out = rg.Vector3d.Multiply(rg.Vector3d.ZAxis,z_retract)
placement_frames = []
offset_placement_frames = []
for brick in bricks:
    placement_frame = brick.frame
    offset_placement_frame = rg.Plane(placement_frame)
    rg.Plane.Translate(offset_placement_frame,leadin_out)
    placement_frames.append(placement_frame)
    offset_placement_frames.append(offset_placement_frame)
# ---------- end python_5 ----------

# ---- group: Home Position (Internalized)
point = Point(Point(0.0585759388, 0.5014587037, 0.444386154))
plane = Plane(point)
prot = RotatePlane(Plane=plane, Angle=degrees(180))

# ----
# Compose path frames
lng_2 = ListLength(List=python_4.pickup_frames)
series = Series(Start=0, Step=1, Count="7")
repeat_2 = RepeatData(Data=prot, Length=lng_2)
weave = Weave(
    Pattern=series,
    Stream0=repeat_2,
    Stream1=python_4.offset_pickup_frames,
    Stream2=python_4.pickup_frames,
    Stream3=python_4.offset_pickup_frames,
    Stream4=repeat_2,
    Stream5=python_5.offset_placement_frames,
    Stream6=python_5.placement_frames,
    Stream7=python_5.offset_placement_frames,
    NullGaps=False)

pflip = FlipPlane(Plane=weave, ReverseX=False, ReverseY=False, SwapAxes=True)
v = GhPythonScript(gh_plane=pflip)  # -> compas_frame; inputs gh_plane: Plane
# ---------- v: Python ----------
from compas_rhino.conversions import plane_to_compas_frame

compas_frame = plane_to_compas_frame(gh_plane)
# ---------- end v ----------

# ----
# Connect to ROS Bridge
connect = BooleanToggle(False)
ros = ROSConnect(connect=connect)  # -> ros_client, is_connected; inputs port: Int32, connect: Boolean
#   port ip: The ip address ROS. Defaults to 127.0.0.1.
#   port port: The port of ROS. Defaults to 9090.
#   port connect: If True, connects to ROS. If False, disconnects from ROS. Defaults to False.
#   port ros_client: The ROS client.
#   port is_connected: True if connection established.
# ---------- ros: Python ----------
"""
Connect or disconnect to ROS.

COMPAS FAB v0.27.0
"""
from ghpythonlib.componentbase import executingcomponent as component
from scriptcontext import sticky as st

from compas_fab.backends import RosClient
from compas_fab.ghpython.components import create_id


class ROSConnect(component):
    def RunScript(self, ip, port, connect):
        ros_client = None

        ip = ip or '127.0.0.1'
        port = port or 9090

        key = create_id(self, 'ros_client')
        ros_client = st.get(key, None)

        if ros_client:
            st[key].close()
        if connect:
            st[key] = RosClient(ip, port)
            st[key].run(5)

        ros_client = st.get(key, None)
        is_connected = ros_client.is_connected if ros_client else False
        return (ros_client, is_connected)
# ---------- end ros ----------

# ----
# Reset Planning Scene
# (Clear collision and attached
# collision meshes)
button = Button()
reset_planning_scene = GhPythonScript(ros_client=ros.ros_client, reset_planning_scene=button)  # -> out, success; inputs reset_planning_scene: Boolean
# ---------- reset_planning_scene: Python ----------
# Daniel Ruan - deltar@umich.edu | 03/21/2023

import roslibpy as rlp

from scriptcontext import sticky as st

from compas_fab.backends.interfaces import GetPlanningScene
from compas_fab.backends.ros.messages import GetPlanningSceneRequest
from compas_fab.backends.ros.messages import GetPlanningSceneResponse
from compas_fab.backends.ros.messages import PlanningSceneComponents
from compas_fab.backends.ros.messages import CollisionObject


def edit_headers(d):
    if isinstance(d, list) and not isinstance(d, basestring):
        for i in d:
            edit_headers(i)
    if isinstance(d, dict):
        for key, value in d.items():
            if key == 'stamp':
                d.pop('stamp')
            if key == 'seq':
                d.pop('seq')
            edit_headers(value)

def edit_keys(d):
    if isinstance(d, list) and not isinstance(d, basestring):
        for i in d:
            edit_keys(i)
    if isinstance(d, dict):
        for key, value in d.items():
            if key == 'nanosec':
                d['nsecs'] = d.pop('nanosec')
            if key == 'sec':
                d['secs'] = d.pop('sec')
            edit_keys(value)


guid = str(ghenv.Component.InstanceGuid)
success_key = "success_" + guid

if success_key not in st:
    st[success_key] = None

if ros_client and ros_client.is_connected and reset_planning_scene:
    request = dict(
        components=PlanningSceneComponents(
            PlanningSceneComponents.SCENE_SETTINGS
            | PlanningSceneComponents.ROBOT_STATE
            | PlanningSceneComponents.ROBOT_STATE_ATTACHED_OBJECTS
            | PlanningSceneComponents.WORLD_OBJECT_NAMES
            | PlanningSceneComponents.WORLD_OBJECT_GEOMETRY
            | PlanningSceneComponents.ALLOWED_COLLISION_MATRIX
            | PlanningSceneComponents.OBJECT_COLORS
        ).msg
    )
    
    gps_service = rlp.Service(ros_client, '/get_planning_scene', 'moveit_msgs/srv/GetPlanningScene')
    gps_request = rlp.ServiceRequest(request)
    response = gps_service.call(gps_request)
    
    edit_keys(dict(response))
    
    scene = GetPlanningSceneResponse.from_msg(response)
    
    for collision_object in scene.world.collision_objects:
        collision_object.operation = CollisionObject.REMOVE
    for collision_object in scene.robot_state.attached_collision_objects:
        collision_object.object["operation"] = CollisionObject.REMOVE
    scene.is_diff = True
    scene.robot_state.is_diff = True
    
    request = scene.msg
    edit_headers(dict(request))
    aps_service = rlp.Service(ros_client, '/apply_planning_scene', 'moveit_msgs/srv/ApplyPlanningScene')
    aps_request = rlp.ServiceRequest({'scene':request})
    response = aps_service.call(aps_request)
    
    edit_keys(dict(response))
    
    st[success_key] = bool(response['success'])

success = st[success_key]
# ---------- end reset_planning_scene ----------

# ----
# Load Robot and End Effector
pt = Point(Point(0.1293266, 0.01387508148, -0.01514199437))
pt_2 = Point(Point(0.1293266, 0.009363422178, 0.008579995637))
pt_3 = Point(Point(0.1293266, 0, 0))
gripper_tcp = Plane3Pt(PointA=pt_3, PointB=pt, PointC=pt_2)
v_2 = GhPythonScript(gh_plane=gripper_tcp)  # -> compas_frame; same code as v
gripper_stl = FilePath("G:\Shared drives\ADR_Drive\04_Teaching\02_RoboticFabrication_W23\21_Files\Week11\KR6_Gripper.stl")
load_robot = GhPythonScript(
    ros_client=ros.ros_client,
    mesh_directory="G:\Shared drives\ADR_Drive\12_Infrastructure\04_Robots",
    mesh_package="kr6_base_description",
    tool_stl=gripper_stl,
    tool_frame=v_2,
    load=Button())  # -> out, robot; inputs load: Boolean
# ---------- load_robot: Python ----------
import os
import re
import compas
import roslibpy as rlp

import Grasshopper.Kernel
from ghpythonlib.componentbase import executingcomponent as component

from scriptcontext import sticky as st

from compas.robots import LocalPackageMeshLoader
from compas.robots import RobotModel

from compas_ghpython.artists import RobotModelArtist
from compas_fab.robots import Robot
from compas_fab.robots import RobotSemantics

from compas.datastructures import Mesh
from compas_fab.robots import Tool
from compas.geometry import Scale

from compas_fab.backends.ros.messages import ROSmsg
from compas_fab.ghpython.components import create_id

class LoadRobotROS(component):
    def RunScript(self, ros_client, mesh_directory, mesh_package, tool_stl, tool_frame, load):
        compas.PRECISION = '12f'
        
        # store robot in component
        guid = str(ghenv.Component.InstanceGuid)
        robot_key = "robot_" + guid
        
        if robot_key not in st:
            st[robot_key] = None
        
        self.urdf_key = create_id(self, 'urdf')
        self.srdf_key = create_id(self, 'srdf')
        
        if ros_client and ros_client.is_connected and load:
            
            urdf_service = rlp.Service(ros_client, '/robot_state_publisher/get_parameters', 'rcl_interfaces/srv/GetParameters')
            urdf_request = rlp.ServiceRequest({'names':['robot_description']})
            urdf = urdf_service.call(urdf_request)['values'][0]['string_value']
            
            srdf_service = rlp.Service(ros_client, '/move_group/get_parameters', 'rcl_interfaces/srv/GetParameters')
            srdf_request = rlp.ServiceRequest({'names':['robot_description_semantic']})
            srdf = srdf_service.call(srdf_request)['values'][0]['string_value']
            
            model = RobotModel.from_urdf_string(urdf)
            semantics = RobotSemantics.from_srdf_string(srdf, model)
            
            loader = LocalPackageMeshLoader(mesh_directory, mesh_package)
            model.load_geometry(loader)
            
            st[robot_key] = Robot(model, semantics=semantics, client=ros_client)
            st[robot_key].artist = RobotModelArtist(st[robot_key].model)
            
            tool_mesh = Mesh.from_stl(tool_stl)
            tool = Tool(tool_mesh, tool_frame, link_name='flange')
            st[robot_key].attach_tool(tool)
            
        robot = st[robot_key]
        if robot:
            robot.info()
        
        return (robot)
# ---------- end load_robot ----------

# ----
# Home configuration
a1 = Slider(-83.4, range=-360..360)
a5 = Slider(61.2, range=-360..360)
a6 = Slider(49.2, range=-360..360)
a2 = Slider(12.7, range=-360..360)
a4 = Slider(0, range=-360..360)
a3 = Slider(16.1, range=-360..360)
set_joint_positions = BooleanToggle(False)
home_joint_positions = Number([-1.455, 0.221, 0.281, 0, 1.069, 0.859])
forward_kinematics = PythonScript(
    robot=load_robot.robot,
    set_joint_positions=set_joint_positions,
    joint_positions=home_joint_positions,
    a1=a1,
    a2=a2,
    a3=a3,
    a4=a4,
    a5=a5,
    a6=a6)  # -> full_configuration; inputs joint_positions: list
# ---------- forward_kinematics: Python ----------
import math
import Grasshopper
from compas.robots import Joint
from compas.robots import Configuration

if set_joint_positions:

    j = 0
    for i in range(ghenv.Component.Params.Input.Count):
        nslider = ghenv.Component.Params.Input[i].Sources[0]
        if nslider.GetType() == Grasshopper.Kernel.Special.GH_NumberSlider:
            nslider.TrySetSliderValue(math.degrees(joint_positions[j]))
            j += 1

if robot:
    joint_positions = [a1, a2, a3, a4, a5, a6]
    joint_types = robot.get_configurable_joint_types()
    joint_names = robot.get_configurable_joint_names()
    for i, joint_type in enumerate(joint_types):
        if joint_type == Joint.REVOLUTE:
            joint_positions[i] = math.radians(joint_positions[i])
    full_configuration = Configuration(joint_positions, joint_types, joint_names)
# ---------- end forward_kinematics ----------

# ----
# MoveIt Path Planning Input
# Convert to COMPAS Frames
home_configuration = Data(forward_kinematics)

# ----
# Planning Scene Add Collision Mesh
test_collision_mesh = Mesh(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)
v_3 = GhPythonScript(id="test_cm", gh_mesh=test_collision_mesh)  # -> compas_CollisionMesh
# ---------- v_3: Python ----------
from compas_rhino.geometry import RhinoMesh
from compas_fab.robots import CollisionMesh

compas_mesh = RhinoMesh.from_guid(gh_mesh).to_compas()
compas_CollisionMesh = CollisionMesh(compas_mesh, id)
# ---------- end v_3 ----------
add_collision_mesh = GhPythonScript(ros_client=ros.ros_client, collision_mesh=v_3, add_collision_mesh=Button())  # -> out, success
# ---------- add_collision_mesh: Python ----------
# Daniel Ruan - deltar@umich.edu | 03/21/2023

import roslibpy as rlp

from scriptcontext import sticky as st

from compas_fab.backends.interfaces import AddCollisionMesh
from compas_fab.backends.ros.messages import ApplyPlanningSceneRequest
from compas_fab.backends.ros.messages import ApplyPlanningSceneResponse
from compas_fab.backends.ros.messages import CollisionObject
from compas_fab.backends.ros.messages import PlanningScene
from compas_fab.backends.ros.messages import PlanningSceneWorld


def edit_headers(d):
    if isinstance(d, list) and not isinstance(d, basestring):
        for i in d:
            edit_headers(i)
    if isinstance(d, dict):
        for key, value in d.items():
            if key == 'stamp':
                d.pop('stamp')
            if key == 'seq':
                d.pop('seq')
            edit_headers(value)

def edit_keys(d):
    if isinstance(d, list) and not isinstance(d, basestring):
        for i in d:
            edit_keys(i)
    if isinstance(d, dict):
        for key, value in d.items():
            if key == 'nanosec':
                d['nsecs'] = d.pop('nanosec')
            if key == 'sec':
                d['secs'] = d.pop('sec')
            edit_keys(value)


guid = str(ghenv.Component.InstanceGuid)
success_key = "success_" + guid

if success_key not in st:
    st[success_key] = None

if ros_client and ros_client.is_connected and add_collision_mesh:
    co = CollisionObject.from_collision_mesh(collision_mesh)
    co.operation = CollisionObject.ADD
    world = PlanningSceneWorld(collision_objects=[co])
    scene = PlanningScene(world=world, is_diff=True)
    request = scene.msg
    
    edit_headers(dict(request))
    
    aps_service = rlp.Service(ros_client, '/apply_planning_scene', 'moveit_msgs/srv/ApplyPlanningScene')
    aps_request = rlp.ServiceRequest({'scene':request})
    response = aps_service.call(aps_request)
    
    edit_keys(dict(response))
    
    st[success_key] = bool(response['success'])

success = st[success_key]
# ---------- end add_collision_mesh ----------

# ----
# Create Attached Collision Mesh
gripper_collision_stl = FilePath("G:\Shared drives\ADR_Drive\04_Teaching\02_RoboticFabrication_W23\21_Files\Week11\KR6_Gripper_Collision.stl")
panel_5 = Panel("""flange
link_6""")
v_4 = GhPythonScript(id="gripper_col", link_name="flange", touch_links=panel_5, mesh_stl=gripper_collision_stl)  # -> compas_AttachedCollisionMesh; inputs touch_links: list
# ---------- v_4: Python ----------
from compas.datastructures import Mesh
from compas_fab.robots import CollisionMesh
from compas_fab.robots import AttachedCollisionMesh

compas_mesh = Mesh.from_stl(mesh_stl)
compas_CollisionMesh = CollisionMesh(compas_mesh, id)
compas_AttachedCollisionMesh = AttachedCollisionMesh(compas_CollisionMesh, link_name, touch_links)
# ---------- end v_4 ----------

info = PythonScript(robot=load_robot.robot)  # -> out, main_group_name, ee_link_name
# ---------- info: Python ----------
if robot:
    robot.info()
    main_group_name = robot.main_group_name
    ee_link_name = robot.get_end_effector_link_name(main_group_name)
# ---------- end info ----------

# ----
# Goal Constraint
constraints_from_plane = ConstraintsFromPlane(robot=load_robot.robot, group=info.main_group_name)  # -> constraints
#   port plane: The plane or frame from which we create position and orientation constraints.
#   port group: The planning group for which we specify the constraint. Defaults to the robot's main planning group.
#   port tolerance_position: The allowed tolerance to the frame's position (defined in the robot's units). Defaults to 0.001
#   port tolerance_xaxis: The allowed tolerance of the frame's X-axis in degrees.
#   port tolerance_yaxis: The allowed tolerance of the frame's Y-axis in degrees.
#   port tolerance_zaxis: The allowed tolerance of the frame's Z-axis in degrees.
#   port constraints: A list containing a position and an orientation constraint.
# ---------- constraints_from_plane: Python ----------
"""
Create a position and an orientation constraint from a plane calculated for the group's end-effector link.

COMPAS FAB v0.27.0
"""
import math

from compas_rhino.conversions import RhinoPlane
from ghpythonlib.componentbase import executingcomponent as component


class ConstraintsFromPlane(component):
    def RunScript(self, robot, plane, group, tolerance_position, tolerance_xaxis, tolerance_yaxis, tolerance_zaxis):
        goal_constraints = None
        if robot and plane:
            tolerance_position = tolerance_position or 0.001
            tolerance_xaxis = tolerance_xaxis or 1.
            tolerance_yaxis = tolerance_yaxis or 1.
            tolerance_zaxis = tolerance_zaxis or 1.

            frame = RhinoPlane.from_geometry(plane).to_compas_frame()
            tolerances_axes = [math.radians(tolerance_xaxis), math.radians(tolerance_yaxis), math.radians(tolerance_zaxis)]
            goal_constraints = robot.constraints_from_frame(frame, tolerance_position, tolerances_axes, group)

        return goal_constraints
# ---------- end constraints_from_plane ----------

# ----
# Cartesian Path
toggle = BooleanToggle(False)
max_step_in_meters = Panel("0.01")
compute_cartesian_path = GhPythonScript(
    robot=load_robot.robot,
    start_configuration=home_configuration,
    group_name=info.main_group_name,
    frames=v,
    max_step=max_step_in_meters,
    jump_threshold="0.0",
    avoid_collisions=toggle,
    max_cartesian_speed="0.0",
    plan_trajectory=Button())  # -> out, robot, group, trajectory; inputs frames: list, avoid_collisions: Boolean, attached_collision_meshes: list, plan_trajectory: Boolean
# ---------- compute_cartesian_path: Python ----------
# Daniel Ruan - deltar@umich.edu | 03/21/2023

import roslibpy as rlp

from scriptcontext import sticky as st

from compas.geometry import Frame

from compas_fab.backends.ros.messages import ROSmsg
from compas_fab.backends.ros.messages import Pose
from compas_fab.backends.ros.messages import JointState
from compas_fab.backends.ros.messages import MultiDOFJointState
from compas_fab.backends.ros.messages import RobotState
from compas_fab.backends.ros.messages import AttachedCollisionObject
from compas_fab.backends.ros.messages import GetCartesianPathResponse

from compas_fab.backends.ros.backend_features.helpers import convert_constraints_to_rosmsg
from compas_fab.backends.ros.backend_features.helpers import convert_trajectory


class Header2(ROSmsg):
    ROS_MSG_TYPE = "std_msgs/Header"
    def __init__(self, frame_id="/world"):
        self.frame_id = frame_id

def edit_keys(d):
    if isinstance(d, list) and not isinstance(d, basestring):
        for i in d:
            edit_keys(i)
    if isinstance(d, dict):
        for key, value in d.items():
            if key == 'nanosec':
                d['nsecs'] = d.pop('nanosec')
            if key == 'sec':
                d['secs'] = d.pop('sec')
            edit_keys(value)


ros_client = None
if robot:
    ros_client = robot.client

guid = str(ghenv.Component.InstanceGuid)
trajectory_key = "trajectory_" + guid

if trajectory_key not in st:
    st[trajectory_key] = None

if ros_client and ros_client.is_connected and plan_trajectory:
    
    header = Header2()
    
    request = dict(
        #header=header.msg,
        group_name=group_name,
        #link_name=link_name,
        max_step=float(max_step),
        jump_threshold=float(jump_threshold),
        avoid_collisions=bool(avoid_collisions),
    )
    
    joint_state = JointState(header=header, name=start_configuration.joint_names, position=start_configuration.joint_values)
    start_state = RobotState(joint_state, MultiDOFJointState(header=header), is_diff=True)
    
    if attached_collision_meshes:
        for acm in attached_collision_meshes:
            aco = AttachedCollisionObject.from_attached_collision_mesh(acm)
            start_state.attached_collision_objects.append(aco)
    request['start_state'] = start_state.msg
    
    #link_name = None
    
    frames = robot.from_tcf_to_t0cf(frames)
    waypoints = [Pose.from_frame(frame).msg for frame in frames]
    request['waypoints'] = waypoints
    
    if path_constraints:
        path_constraints = convert_constraints_to_rosmsg(path_constraints, header).msg
        request['path_constraints'] = path_constraint
    
    if cartesian_speed_limited_link:
        request['cartesian_speed_limited_link'] = cartesian_speed_limited_link
        request['max_cartesian_speed'] = max_cartesian_speed
    
    planner_service = rlp.Service(ros_client, '/compute_cartesian_path', 'moveit_msgs/srv/GetCartesianPath')
    planner_request = rlp.ServiceRequest(request)
    response = planner_service.call(planner_request)
    
    edit_keys(dict(response))
    
    cp_response = GetCartesianPathResponse.from_msg(response)
    
    joints = {j.name: j.type for j in robot.model.joints}
    
    st[trajectory_key] = convert_trajectory(joints, cp_response.solution, cp_response.start_state, cp_response.fraction, None, cp_response)
        

group = group_name
trajectory = st[trajectory_key]
# ---------- end compute_cartesian_path ----------
trajectory_visualize = TrajectoryVisualize(robot=compute_cartesian_path.robot, group=compute_cartesian_path.group, trajectory=compute_cartesian_path.trajectory)  # -> start_configuration, configurations, fraction, time, planes, P, V, A
#   port group: The planning group for which this trajectory was planned.
#   port trajectory: The calculated trajectory.
#   port start_configuration: The start configuration of the trajectory.
#   port configurations: The full configurations along the trajectory.
#   port fraction: Indicates the fraction of requested trajectory that was calculated, e.g. 1 means the full trajectory was found.
#   port time: The time which is needed to execute that trajectory at full speed.
#   port planes: The planes of the robot's end-effector.
#   port P: The positions along the trajectory
#   port V: The velocities along the trajectory
#   port A: The accelerations along the trajectory
# ---------- trajectory_visualize: Python ----------
"""
Visualizes a trajectory.

COMPAS FAB v0.27.0
"""
from compas_ghpython import draw_frame
from compas_ghpython import list_to_ghtree
from ghpythonlib.componentbase import executingcomponent as component


class TrajectoryVisualize(component):
    def RunScript(self, robot, group, trajectory):
        start_configuration = None
        configurations = []
        fraction = 0.
        time = 0.

        planes = []
        positions = []
        velocities = []
        accelerations = []

        if robot and trajectory:
            group = group or robot.main_group_name

            for c in trajectory.points:
                configurations.append(robot.merge_group_with_full_configuration(c, trajectory.start_configuration, group))
                frame = robot.forward_kinematics(c, group, options=dict(solver='model'))
                planes.append(draw_frame(frame))
                positions.append(c.positions)
                velocities.append(c.velocities)
                accelerations.append(c.accelerations)

            start_configuration = trajectory.start_configuration
            fraction = trajectory.fraction
            time = trajectory.time_from_start

        P = list_to_ghtree(list(zip(*positions)))
        V = list_to_ghtree(list(zip(*velocities)))
        A = list_to_ghtree(list(zip(*accelerations)))

        # return outputs if you have them; here I try it for you:
        return (start_configuration, configurations, fraction, time, planes, P, V, A)
# ---------- end trajectory_visualize ----------
panel_6 = Panel(trajectory_visualize.fraction)

# ----
# Kinematic Path
button_2 = Button()
plan_kinematic_path = GhPythonScript(
    robot=load_robot.robot,
    group_name=info.main_group_name,
    attached_collision_meshes=v_4,
    goal_constraints=constraints_from_plane,
    num_planning_attempts="1",
    allowed_planning_time="2.0",
    max_velocity_scaling_factor="1.0",
    max_acceleration_scaling_factor="1.0",
    planner_id="RRTConnect",
    plan_trajectory=button_2)  # -> out, robot, group, trajectory; inputs attached_collision_meshes: list, goal_constraints: list, path_constraints: list, trajectory_constraints: list, num_planning_attempts: Int32
# ---------- plan_kinematic_path: Python ----------
# Daniel Ruan - deltar@umich.edu | 03/21/2023

import roslibpy as rlp

from scriptcontext import sticky as st

from compas.geometry import Frame

from compas_fab.backends.ros.messages import ROSmsg
from compas_fab.backends.ros.messages import Pose
from compas_fab.backends.ros.messages import JointState
from compas_fab.backends.ros.messages import MultiDOFJointState
from compas_fab.backends.ros.messages import RobotState
from compas_fab.backends.ros.messages import AttachedCollisionObject
from compas_fab.backends.ros.messages import TrajectoryConstraints
from compas_fab.backends.ros.messages import MotionPlanResponse

from compas_fab.backends.ros.backend_features.helpers import convert_constraints_to_rosmsg
from compas_fab.backends.ros.backend_features.helpers import convert_trajectory


class Header2(ROSmsg):
    ROS_MSG_TYPE = "std_msgs/Header"
    def __init__(self, frame_id="/world"):
        self.frame_id = frame_id

def edit_headers(d):
    if isinstance(d, list) and not isinstance(d, basestring):
        for i in d:
            edit_headers(i)
    if isinstance(d, dict):
        for key, value in d.items():
            if key == 'stamp':
                d.pop('stamp')
            if key == 'seq':
                d.pop('seq')
            edit_headers(value)

def edit_keys(d):
    if isinstance(d, list) and not isinstance(d, basestring):
        for i in d:
            edit_keys(i)
    if isinstance(d, dict):
        for key, value in d.items():
            if key == 'nanosec':
                d['nsecs'] = d.pop('nanosec')
            if key == 'sec':
                d['secs'] = d.pop('sec')
            edit_keys(value)


ros_client = None
if robot:
    ros_client = robot.client

guid = str(ghenv.Component.InstanceGuid)
trajectory_key = "trajectory_" + guid

if trajectory_key not in st:
    st[trajectory_key] = None

if ros_client and ros_client.is_connected and plan_trajectory:
    
    header = Header2()
    
    if planner_id is None:
        planner_id = "RRTConnect"
    
    request = dict(
        #header = header.msg,
        group_name=group_name,
        num_planning_attempts=int(num_planning_attempts),
        allowed_planning_time=float(allowed_planning_time),
        max_velocity_scaling_factor=float(max_velocity_scaling_factor),
        max_acceleration_scaling_factor=float(max_acceleration_scaling_factor),
        planner_id=planner_id,
    )
    
    joint_state = JointState(header=header, name=start_configuration.joint_names, position=start_configuration.joint_values)
    start_state = RobotState(joint_state, MultiDOFJointState(header=header), is_diff=True)
    
    if attached_collision_meshes:
        for acm in attached_collision_meshes:
            aco = AttachedCollisionObject.from_attached_collision_mesh(acm)
            start_state.attached_collision_objects.append(aco)
    request['start_state'] = start_state.msg
    
    if goal_constraints:
        goal_constraints = [convert_constraints_to_rosmsg(goal_constraints, header).msg]
        request['goal_constraints'] = goal_constraints
        
    if path_constraints:
        path_constraints = convert_constraints_to_rosmsg(path_constraints, header).msg
        request['path_constraints'] = path_constraints
    if trajectory_constraints:
        trajectory_constraints = TrajectoryConstraints(constraints=[convert_constraints_to_rosmsg(trajectory_constraints, header)])
        request['trajectory_constraints'] = trajectory_constraints.msg
    
    edit_headers(dict(request))
    
    planner_service = rlp.Service(ros_client, '/plan_kinematic_path', 'moveit_msgs/srv/GetMotionPlan')
    planner_request = rlp.ServiceRequest({'motion_plan_request':request})
    response = planner_service.call(planner_request)
    
    edit_keys(dict(response))
    
    mp_response = MotionPlanResponse.from_msg(response)
    
    joints = {j.name: j.type for j in robot.model.joints}
    
    st[trajectory_key] = convert_trajectory(joints, mp_response.trajectory, mp_response.trajectory_start, 1.0, mp_response.planning_time, mp_response)
    

group = group_name
trajectory = st[trajectory_key]
# ---------- end plan_kinematic_path ----------
trajectory_visualize_2 = TrajectoryVisualize(robot=plan_kinematic_path.robot, group=plan_kinematic_path.group, trajectory=plan_kinematic_path.trajectory)  # -> start_configuration, configurations, fraction, time, planes, P, V, A; same code as trajectory_visualize

panel_7 = Panel(load_robot.out)
panel_8 = Panel(info.ee_link_name)

# ----
# Visualization
configurations = Data(trajectory_visualize.configurations)
item_3 = ListItem(List=configurations, Index=Slider(0, range=0..500), Wrap=True)
show_end_effector_frame = BooleanToggle(True)
show_base_frame = BooleanToggle(False)
show_collision = BooleanToggle(True)
show_frames = BooleanToggle(True)
show_visual = BooleanToggle(True)
show_acm = BooleanToggle(False)
show_cm = BooleanToggle(False)
robot_visualize = RobotVisualize(
    robot=load_robot.robot,
    group=info.main_group_name,
    configuration=item_3,
    show_visual=show_visual,
    show_collision=show_collision,
    show_frames=show_frames,
    show_base_frame=show_base_frame,
    show_end_effector_frame=show_end_effector_frame,
    show_cm=show_cm,
    show_acm=show_acm)  # -> visual, collision, collision_meshes, attached_meshes, frames, base_frame, ee_frame; inputs show_visual: Boolean, show_collision: Boolean, show_frames: Boolean, show_base_frame: Boolean, show_end_effector_frame: Boolean, show_cm: Boolean, show_acm: Boolean
#   port group: The planning group used for end-effector and base visualization.
#   port configuration: The robot's full configuration.
#   port show_visual: Whether or not to show the robot's visual meshes.
#   port show_collision: Whether or not to show the robot's collision meshes.
#   port show_frames: Whether or not to show the robot's joint frames.
#   port show_base_frame: Whether or not to show the robot's base frame.
#   port show_end_effector_frame: Whether or not to show the robot's end-effector frame.
#   port show_cm: Whether or not to show the collision meshes (if any).
#   port show_acm: Whether or not to show the attached collision meshes (if any).
#   port visual: Rhino meshes of the robot's visual geometry (if any).
#   port collision: Rhino meshes of the robot's collision geometry (if any).
#   port collision_meshes: Rhino meshes of the scene's collision meshes (if any).
#   port attached_meshes: Rhino meshes of the scene's attached collision meshes (if any).
#   port frames: The robot's joint frames as Rhino planes (if any).
#   port base_frame: The robot's base frame as a Rhino plane (if any).
#   port ee_frame: The robot's end-effector frame as a Rhino plane (if any).
# ---------- robot_visualize: Python ----------
"""
Visualizes the robot.

COMPAS FAB v0.27.0
"""
from compas.artists import Artist
from compas.geometry import Frame
from compas.geometry import Transformation
from compas_fab.robots import PlanningScene
from ghpythonlib.componentbase import executingcomponent as component


class RobotVisualize(component):
    def RunScript(
        self,
        robot,
        group,
        configuration,
        show_visual,
        show_collision,
        show_frames,
        show_base_frame,
        show_end_effector_frame,
        show_cm,
        show_acm,
    ):

        visual = None
        collision = None
        collision_meshes = None
        attached_meshes = None
        frames = None
        base_frame = None
        ee_frame = None

        if robot:
            show_visual = True if show_visual is None else show_visual
            show_cm = True if show_cm is None else show_cm
            show_acm = True if show_acm is None else show_acm
            configuration = configuration or robot.zero_configuration()

            robot.update(configuration, visual=show_visual, collision=show_collision)
            compas_frames = robot.transformed_frames(configuration, group)

            if show_visual:
                visual = robot.artist.draw_visual()

            if show_collision:
                collision = robot.artist.draw_collision()

            if show_base_frame:
                base_compas_frame = compas_frames[0]
                artist = Artist(base_compas_frame)
                base_frame = artist.draw()

            if show_end_effector_frame:
                ee_compas_frame = robot.forward_kinematics(
                    configuration, group, options=dict(solver="model")
                )
                artist = Artist(ee_compas_frame)
                ee_frame = artist.draw()

            if show_frames:
                frames = []
                for compas_frame in compas_frames[1:]:
                    artist = Artist(compas_frame)
                    frame = artist.draw()
                    frames.append(frame)

            if show_cm or show_acm:
                scene = PlanningScene(robot)
                scene = robot.client.get_planning_scene()

                collision_meshes = []
                attached_meshes = []

                if show_cm:
                    for co in scene.world.collision_objects:
                        header = co.header
                        frame_id = header.frame_id
                        cms = co.to_collision_meshes()

                        for cm in cms:
                            if cm.frame != Frame.worldXY():
                                t = Transformation.from_frame(cm.frame)
                                mesh = cm.mesh.transformed(t)
                            else:
                                mesh = cm.mesh

                            collision_meshes.append(Artist(mesh).draw())

                if show_acm:
                    for aco in scene.robot_state.attached_collision_objects:
                        for acm in aco.to_attached_collision_meshes():
                            frame_id = aco.object["header"]["frame_id"]
                            frame = robot.forward_kinematics(
                                configuration, options=dict(link=frame_id)
                            )
                            t = Transformation.from_frame(frame)

                            # Local CM frame
                            if (
                                acm.collision_mesh.frame
                                and acm.collision_mesh.frame != Frame.worldXY()
                            ):
                                t = t * Transformation.from_frame(
                                    acm.collision_mesh.frame
                                )

                            mesh = acm.collision_mesh.mesh.transformed(t)

                            attached_meshes.append(Artist(mesh).draw())

        return (
            visual,
            collision,
            collision_meshes,
            attached_meshes,
            frames,
            base_frame,
            ee_frame,
        )
# ---------- end robot_visualize ----------
geo = Geometry(robot_visualize.visual)

# ----
# Export to KRL
# This is a simple of example of how to parse the configurations into KRL. You'll still need to add other critical components, like tool/base, I/O, halts, etc.
panel_9 = Panel("20")
tokrl = GhPythonScript(configurations=trajectory_visualize.configurations, CORI_approx="10", CPTP_approx=panel_9)  # -> out, KRL; inputs configurations: list
# ---------- tokrl: Python ----------
import math

KRL = "$APO.CORI={0}\n$APO.CPTP={1}\n".format(CORI_approx, CPTP_approx)

for config in configurations:
    jv = [math.degrees(x) for _, x in sorted(zip(config.joint_names, config.joint_values))]
    str = "PTP {{A1 {0:.2f},A2 {1:.2f},A3 {2:.2f},A4 {3:.2f},A5 {4:.2f},A6 {5:.2f}}} C_PTP \n"
    KRL += str.format(jv[0], jv[1], jv[2], jv[3], jv[4], jv[5])
# ---------- end tokrl ----------
